# Grasshopper definition draw2D.gh (Grasshopper 1.0.8)
# plug-ins: Ars Post Faber

number_slider = Slider(200, range=0..1000)
curve = Curve(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)
draw2d = Draw2D(
    Start=Toggle(True),
    InputCurves=curve,
    BedSizeX=number_slider,
    BedSizeY=number_slider,
    LiftHeight=Slider(2, range=0..10),
    ZDown=0,
    FeedRate=Slider(3000, range=0..10000),
    TravelRate=Slider(6000, range=0..10000))  # -> ServerURL, OutputCurves, GCode
panel = Panel(draw2d.ServerURL)
panel_2 = Panel(draw2d.OutputCurves)
panel_3 = Panel(draw2d.GCode)
