# Grasshopper definition serial.gh (Grasshopper 1.0.8)
# plug-ins: CRFT Tools

serial_ports = SerialPorts({"debug-console": "cu.debug-console", "JBLRACETWS": "cu.JBLRACETWS", "Bluetooth-Incoming-Port": "cu.Bluetooth-Incoming-Port", "usbserial-130": "cu.usbserial-130"}, selected="usbserial-130")
serial_control = SerialControl(
    Port=serial_ports,
    BaudRate=115200,
    Connect=Toggle(False),
    Start=False,
    Pause=False,
    Resume=False,
    Stop=False,
    Command="G53 Z0.0;",
    SendCommand=Button(),
    Home=False)  # -> Connected, Printing, Paused, Response, Status, PortEvent
panel = Panel(serial_control.Connected)
panel_2 = Panel(serial_control.PortEvent)
panel_3 = Panel(serial_control.Status)
panel_4 = Panel(serial_control.Response)
