# Grasshopper definition tests_for_gcode.gh (Grasshopper 1.0.8)
# plug-ins: CRFT Tools

list = SerialPorts({"cu.debug-console", "cu.JBLRACETWS", "cu.Bluetooth-Incoming-Port"}, selected="cu.debug-console")
number_slider = Slider(11, range=0..100)
multiplication = Multiplication(A=number_slider, B=Slider(2.5, range=0..10))
circle = Circle(Plane=PlaneXY(0, 0, 0), Radius=number_slider)
unit_z = UnitZ(Factor=multiplication)
extrude = Extrude(Base=circle, Direction=unit_z)
cap_holes = CapHoles(Brep=extrude)
slicer_settings = SlicerSettings(LayerHeight=0.2, WallOffset=0.4, Shells=2, InfillSpacing=10, PrintSpeed=1500, NozzleDiameter=0.4)
brep = Brep(cap_holes)
slice_geometry = SliceGeometry(Geometry=brep, Settings=slicer_settings)  # -> Layers, L
g_code_generator = GCodeGenerator(Settings=slicer_settings, Layers=slice_geometry.L)
serial_control = SerialControl(
    Port=list,
    BaudRate=115200,
    Connect=False,
    Command=g_code_generator,
    Reset=False,
    BoundingBox=Vector(220, 220, 250),
    ShowBBox=False,
    Samples=0)  # -> Response, PortEvent, Path, GCode
